% Simulink data dictionary dc_motor_load_model_inverse_forward_ANN_models.sldd

B_load = 0.0047
B_motor = 0.00025
B_reducer = 0.001
GearRatio = 1
J_hysteresis_brake = 0.0016118
J_load = 0.0016118
J_motor = 0.0002548
J_reducer = 1.0e-5
L_motor = 6.0e-6
R_motor = 0.015
ke = 0.039313695
kt = 0.0378